# Dynamo graph 1.3.1 Selecting Elements Through a Link.dyn (Dynamo 1.3.1.1736)

file_path = Filename("D:\Dynamo\test.xlsx")
code_block = CodeBlock { "Elevation"; "Levels"; }
code_block_2 = CodeBlock { 0; true; }
categories = Categories("Levels")
all_elements_of_category = ElementsOfCategory(categories)

# group: archi-lab grimshaw
# note: Author: Edwin Guerra
# Summit Technologies Ltd.
# 2017-11-01
# This script demonstrates how to access elements in linked files, specifically levels to compare naming and elevation.
get_documents = Custom[Get Documents]()  # Queries all linked Revit files and retrieves their Name, LinkInstance and Document properties.

# group: steamnodes
getFromLinkedFile = Custom[Element.GetFromLinkedFile](Link_Instance=get_documents.Link_Instance, Link_Document=get_documents.Link_Doc, Category=categories)  # Get elements from link document instance based on category

create = List.Create(all_elements_of_category, getFromLinkedFile)
name = Element.Name(create)
getParameterValueByName = Element.GetParameterValueByName(element=create, parameterName=code_block.out0)
string_from_object = FromObject(getParameterValueByName)
code_block_3 = CodeBlock(a=name, b=string_from_object) { a+" "+b; }
sort = List.Sort(code_block_3)
transpose = List.Transpose(sort)
writeToFile = Excel.WriteToFile(filePath=file_path, sheetName=code_block.out1, startRow=code_block_2.out0, startCol=code_block_2.out0, data=transpose, overWrite=code_block_2.out1)
