# Dynamo graph 1.3.2 Workset Assignment by Category.dyn (Dynamo 1.3.2.2480)

# note: Author: Edwin Guerra
# 2018-02-27
# This script demonstrates the automatic assignment of worksets based on categories.
categories = Categories("Walls")
all_elements_of_category = ElementsOfCategory(categories)
categories_2 = Categories("Floors")
all_elements_of_category_2 = ElementsOfCategory(categories_2)
create = List.Create(all_elements_of_category, all_elements_of_category_2)
flatten = Flatten(create)
code_block = CodeBlock { "Workset"; }

# group: archi-lab.net
worksets = WorksetUi("Workset1")
id = archilab.Revit.Elements.Workset.Id(worksets)

setParameterByName = Element.SetParameterByName(element=flatten, parameterName=code_block, value=id)
