# Dynamo graph CAD TO POINT.dyn (Dynamo 1.3.3.4111)

select_model_elements = DSModelElementsSelection()  # 1 picked in the model
geometry = Element.Geometry(select_model_elements)
watch = Watch(geometry)
string = StringInput("Ellipse")
filterByBoolMask = List.FilterByBoolMask(list=select_model_elements, mask=string)
fromLayers = CADTextData.FromLayers()  # unwired: arg0
pointsFromCADLayers = CAD.PointsFromCADLayers()  # unwired: arg0
string_2 = StringInput("FIRE SPRINKLER")
curvesFromCADLayers = CAD.CurvesFromCADLayers(select_model_elements, string_2)
watch_2 = Watch(curvesFromCADLayers)
pointAtSegmentLength = Curve.PointAtSegmentLength(curve=watch_2)
watch_3 = Watch(pointAtSegmentLength)
