# Dynamo graph GRID BY CAD PLAN.dyn (Dynamo 1.3.0.875)

select_model_element = DSModelElementSelection()  # 1 picked in the model
curves = Element.Curves(select_model_element)
startPoint = Curve.StartPoint(curves)
endPoint = Curve.EndPoint(curves)
byStartPointEndPoint = Grid.ByStartPointEndPoint(startPoint, endPoint)
