# Dynamo graph IMPORT+GEOMETRY.dyn (Dynamo 1.3.3.4111)

file_path = Filename("C:\Users\IAA\Desktop\point co-ordinates.xlsx")
fromPath = FileObject(file_path)  # "File.FromPath"
string = StringInput("POINTS")
boolean = BoolSelector(false)
readFromFile = Excel.ReadFromFile(file=fromPath, sheetName=string, readAsStrings=boolean)
transpose = List.Transpose(readFromFile)
number = DoubleInput(0)
getItemAtIndex = List.GetItemAtIndex(list=transpose, index=number)
boolean_2 = BoolSelector(true)
clean = List.Clean(list=getItemAtIndex, preserveIndices=boolean_2)
transpose_2 = List.Transpose(readFromFile)
number_2 = DoubleInput(1)
getItemAtIndex_2 = List.GetItemAtIndex(list=transpose_2, index=number_2)
boolean_3 = BoolSelector(true)
clean_2 = List.Clean(list=getItemAtIndex_2, preserveIndices=boolean_3)
transpose_3 = List.Transpose(readFromFile)
number_3 = DoubleInput(1)
getItemAtIndex_3 = List.GetItemAtIndex(list=transpose_3, index=number_3)
boolean_4 = BoolSelector(true)
clean_3 = List.Clean(list=getItemAtIndex_3, preserveIndices=boolean_4)
byCoordinates = Point.ByCoordinates(x=clean, y=clean_2, z=clean_3)
ZAxis = Vector.ZAxis()
byOriginNormal = Plane.ByOriginNormal(origin=byCoordinates, normal=ZAxis)
number_4 = DoubleInput(10)
number_5 = DoubleInput(10)
byWidthLength = Rectangle.ByWidthLength(plane=byOriginNormal, width=number_4, length=number_5)
ZAxis_2 = Vector.ZAxis()
number_6 = DoubleInput(1)
extrude = Curve.Extrude(curve=byWidthLength, direction=ZAxis_2, distance=number_6)
number_7 = DoubleInput(1.5)
thicken = Surface.Thicken(surface=extrude, thickness=number_7)
