# Dynamo graph INPUT FAMILY CODES.dyn (Dynamo 1.3.3.4111)

family_types = FamilyTypes("QAF_QDC_MEP_PA_M_GATE VALVE:40mm")
code_block = CodeBlock { "Assembly Code"; "Description"; "Keynote"; }
create = List.Create(code_block.out0, code_block.out1, code_block.out2)
code_block_2 = CodeBlock { "D20"; "elcectric water heater"; "151150"; }
create_2 = List.Create(code_block_2.out0, code_block_2.out1, code_block_2.out2)
setParameterByName = Element.SetParameterByName(element=family_types, parameterName=create, value=create_2)
