# Dynamo graph INPUT FAMILY CODES_____________________.dyn (Dynamo 1.3.0.875)

family_types = FamilyTypes("QAF_QDC_MEP_ME_ELECTRIC WATER HEATER:EWH-01")
code_block = CodeBlock { "Heat Capacity"; "Frequency"; "Voltage"; "Phase"; "Capacity"; }
create = List.Create(code_block.out0, code_block.out1, code_block.out2)
code_block_2 = CodeBlock { "2000"; "50"; "230"; "1"; "150"; }
create_2 = List.Create(code_block_2.out0, code_block_2.out1, code_block_2.out2)
setParameterByName = Element.SetParameterByName(element=family_types, parameterName=create, value=create_2)
