# Dynamo graph INSULATION BY PIPE SIZE SELECTION.dyn (Dynamo 1.3.2.2480)

# group: PIPES
categories = Categories("PipeCurves")
all_elements_of_category = ElementsOfCategory(categories)
element_types = ElementTypes("PipeInsulationType")
all_elements_of_type = ElementsOfType(element_types)
code_block = CodeBlock(list=all_elements_of_type) { list[0]; }
code_block_2 = CodeBlock { "Diameter"; }
getParameterValueByName = Element.GetParameterValueByName(element=all_elements_of_category, parameterName=code_block_2)
convert_between_units = DynamoConvert(getParameterValueByName, conversionMetric=Length, conversionFrom=Feet, conversionTo=Millimeters)
watch = Watch(convert_between_units)
code_block_3 = CodeBlock { 50; }
le = watch <= code_block_3
code_block_4 = CodeBlock { 25; }
code_block_5 = CodeBlock { 15; }
if_ = If(test=le, true=code_block_4, false=code_block_5)
addInsulation = Custom[Element.AddInsulation](Elements=all_elements_of_category, InsulationType=code_block, Thickness=if_)  # Adds insulation to pipe or duct networks
watch_2 = Watch(getParameterValueByName)
element_types_2 = ElementTypes("Pipe")
all_elements_of_type_2 = ElementsOfType(element_types_2)

# group: pipe fitting
categories_2 = Categories("PipeFitting")
all_elements_of_category_2 = ElementsOfCategory(categories_2)
code_block_6 = CodeBlock { "Nominal Diameter"; }
getParameterValueByName_2 = Element.GetParameterValueByName(element=all_elements_of_category_2, parameterName=code_block_6)
watch_3 = Watch(getParameterValueByName_2)
element_types_3 = ElementTypes("PipeInsulationType")
all_elements_of_type_3 = ElementsOfType(element_types_3)
code_block_7 = CodeBlock(list=all_elements_of_type_3) { list[0]; }
convert_between_units_2 = DynamoConvert(getParameterValueByName_2, conversionMetric=Length, conversionFrom=Feet, conversionTo=Millimeters)
watch_4 = Watch(convert_between_units_2)
code_block_8 = CodeBlock { 50; }
le_2 = watch_4 <= code_block_8
code_block_9 = CodeBlock { 25; }
code_block_10 = CodeBlock { 15; }
if_2 = If(test=le_2, true=code_block_9, false=code_block_10)
addInsulation_2 = Custom[Element.AddInsulation](Elements=all_elements_of_category_2, InsulationType=code_block_7, Thickness=if_2)
