# Dynamo graph INSULATION_BY SYSTEM SELECTION and diameter.dyn (Dynamo 1.3.3.4111)

# group: PIPE SELECTION
categories = Categories("PipeCurves")
all_elements_of_category = ElementsOfCategory(categories)

# group: SYSTEM DECLARATION
code_block = CodeBlock { 4; }
getItemAtIndex = List.GetItemAtIndex(index=code_block)  # unwired: list
code_block_2 = CodeBlock { "System Type"; }
getParameterValueByName = Element.GetParameterValueByName(element=all_elements_of_category, parameterName=code_block_2)
code_block_3 = CodeBlock { "Type Name"; }
getParameterValueByName_2 = Element.GetParameterValueByName(element=getParameterValueByName, parameterName=code_block_3)
groupByKey = List.GroupByKey(list=all_elements_of_category, keys=getParameterValueByName_2)
code_block_4 = CodeBlock(list=groupByKey.groups) { list [0]; }

# group: PIPE INSULATION SELECTION
element_types = ElementTypes("PipeInsulationType")
all_elements_of_type = ElementsOfType(element_types)
code_block_5 = CodeBlock(list=all_elements_of_type) { list [0]; }
code_block_6 = CodeBlock { "Type Name"; }
getParameterValueByName_3 = Element.GetParameterValueByName(element=all_elements_of_type, parameterName=code_block_6)

# group: PIPE INSULATION
addInsulation = Custom[Element.AddInsulation](Elements=code_block_4, InsulationType=code_block_5)  # Adds insulation to pipe or duct networks; unwired: Thickness
code_block_7 = CodeBlock { 13; }

code_block_8 = CodeBlock { "Diameter"; }
getParameterValueByName_4 = Element.GetParameterValueByName(element=all_elements_of_category, parameterName=code_block_8)
watch = Watch(getParameterValueByName_4)
groupByKey_2 = List.GroupByKey(list=all_elements_of_category, keys=watch)
code_block_9 = CodeBlock { 0; 1; 2; 3; 4; 5; 6; }
create = List.Create(code_block_9.out0, code_block_9.out1, code_block_9.out2, code_block_9.out3, code_block_9.out4, code_block_9.out5, code_block_9.out6)
getItemAtIndex_2 = List.GetItemAtIndex(list=groupByKey_2.unique_keys, index=create)
code_block_10 = CodeBlock(list=getItemAtIndex_2) { list[]; }
watch_2 = Watch(code_block_10)
addInsulation_2 = Custom[Element.AddInsulation](Thickness=code_block_7)  # unwired: Elements, InsulationType
