# Dynamo graph INSULATION_BY SYSTEM SELECTION.dyn (Dynamo 1.3.3.4111)

# group: PIPE SELECTION
categories = Categories("PipeCurves")
all_elements_of_category = ElementsOfCategory(categories)

# group: SYSTEM DECLARATION
code_block = CodeBlock { 4; }
getItemAtIndex = List.GetItemAtIndex(index=code_block)  # unwired: list
code_block_2 = CodeBlock { "System Type"; }
getParameterValueByName = Element.GetParameterValueByName(element=all_elements_of_category, parameterName=code_block_2)
code_block_3 = CodeBlock { "Type Name"; }
getParameterValueByName_2 = Element.GetParameterValueByName(element=getParameterValueByName, parameterName=code_block_3)
groupByKey = List.GroupByKey(list=all_elements_of_category, keys=getParameterValueByName_2)
code_block_4 = CodeBlock(list=groupByKey.groups) { list [4]; }

# group: PIPE INSULATION SELECTION
element_types = ElementTypes("PipeInsulationType")
all_elements_of_type = ElementsOfType(element_types)
code_block_5 = CodeBlock(list=all_elements_of_type) { list [0]; }
code_block_6 = CodeBlock { "Type Name"; }
getParameterValueByName_3 = Element.GetParameterValueByName(element=all_elements_of_type, parameterName=code_block_6)

# group: PIPE INSULATION
code_block_7 = CodeBlock { 13; }
addInsulation = Custom[Element.AddInsulation](Elements=code_block_4, InsulationType=code_block_5, Thickness=code_block_7)  # Adds insulation to pipe or duct networks

# group: PIPE FITTING SELECTION
categories_2 = Categories("PipeFitting")
all_elements_of_category_2 = ElementsOfCategory(categories_2)

# group: PIPE FITTING SYSTEM DECLARATION
code_block_8 = CodeBlock { 4; }
getItemAtIndex_2 = List.GetItemAtIndex(index=code_block_8)  # unwired: list
code_block_9 = CodeBlock { "System Type"; }
getParameterValueByName_4 = Element.GetParameterValueByName(element=all_elements_of_category_2, parameterName=code_block_9)
code_block_10 = CodeBlock { "Type Name"; }
getParameterValueByName_5 = Element.GetParameterValueByName(element=getParameterValueByName_4, parameterName=code_block_10)
groupByKey_2 = List.GroupByKey(list=all_elements_of_category_2, keys=getParameterValueByName_5)
code_block_11 = CodeBlock(list=groupByKey_2.groups) { list [4]; }
watch = Watch(code_block_11)

# group: PIPE FITTING INSULATION
addInsulation_2 = Custom[Element.AddInsulation](Elements=watch, InsulationType=code_block_5, Thickness=code_block_7)
