# Dynamo graph INSULATION_CWS+HWS.dyn (Dynamo 1.3.3.4111)

# group: PIPE SELECTION
categories = Categories("PipeCurves")
all_elements_of_category = ElementsOfCategory(categories)

# group: PIPE INSULATION SELECTION
element_types = ElementTypes("PipeInsulationType")
all_elements_of_type = ElementsOfType(element_types)
code_block = CodeBlock(list=all_elements_of_type) { list [0]; }
code_block_2 = CodeBlock { "Type Name"; }
getParameterValueByName = Element.GetParameterValueByName(element=all_elements_of_type, parameterName=code_block_2)

# group: COLD WATER SUPPLY INSULATION
code_block_3 = CodeBlock { "System Type"; }
getParameterValueByName_2 = Element.GetParameterValueByName(element=all_elements_of_category, parameterName=code_block_3)
code_block_4 = CodeBlock { "Type Name"; }
getParameterValueByName_3 = Element.GetParameterValueByName(element=getParameterValueByName_2, parameterName=code_block_4)
groupByKey = List.GroupByKey(list=all_elements_of_category, keys=getParameterValueByName_3)
code_block_5 = CodeBlock(list=groupByKey.groups) { list [4]; }
code_block_6 = CodeBlock { 13; }
addInsulation = Custom[Element.AddInsulation](Elements=code_block_5, InsulationType=code_block, Thickness=code_block_6)  # Adds insulation to pipe or duct networks
code_block_7 = CodeBlock { 4; }
getItemAtIndex = List.GetItemAtIndex(index=code_block_7)  # unwired: list

# group: PIPE FITTING SELECTION
categories_2 = Categories("PipeFitting")
all_elements_of_category_2 = ElementsOfCategory(categories_2)

# group: COLD WATER FITTING INSULATION
code_block_8 = CodeBlock { 4; }
getItemAtIndex_2 = List.GetItemAtIndex(index=code_block_8)  # unwired: list
code_block_9 = CodeBlock { "System Type"; }
getParameterValueByName_4 = Element.GetParameterValueByName(element=all_elements_of_category_2, parameterName=code_block_9)
code_block_10 = CodeBlock { "Type Name"; }
getParameterValueByName_5 = Element.GetParameterValueByName(element=getParameterValueByName_4, parameterName=code_block_10)
groupByKey_2 = List.GroupByKey(list=all_elements_of_category_2, keys=getParameterValueByName_5)
code_block_11 = CodeBlock(list=groupByKey_2.groups) { list [4]; }
watch = Watch(code_block_11)
code_block_12 = CodeBlock { 13; }
addInsulation_2 = Custom[Element.AddInsulation](Elements=watch, InsulationType=code_block, Thickness=code_block_12)

# group: HOT WATER SUPPLY INSULATION
code_block_13 = CodeBlock { "System Type"; }
getParameterValueByName_6 = Element.GetParameterValueByName(element=all_elements_of_category, parameterName=code_block_13)
code_block_14 = CodeBlock { "Type Name"; }
getParameterValueByName_7 = Element.GetParameterValueByName(element=getParameterValueByName_6, parameterName=code_block_14)
groupByKey_3 = List.GroupByKey(list=all_elements_of_category, keys=getParameterValueByName_7)
code_block_15 = CodeBlock(list=groupByKey_3.groups) { list [5]; }
code_block_16 = CodeBlock { 13; }
addInsulation_3 = Custom[Element.AddInsulation](Elements=code_block_15, InsulationType=code_block, Thickness=code_block_16)
code_block_17 = CodeBlock { 4; }
getItemAtIndex_3 = List.GetItemAtIndex(index=code_block_17)  # unwired: list

# group: HOT WATER FITTING INSULATION
code_block_18 = CodeBlock { 4; }
getItemAtIndex_4 = List.GetItemAtIndex(index=code_block_18)  # unwired: list
code_block_19 = CodeBlock { "System Type"; }
getParameterValueByName_8 = Element.GetParameterValueByName(element=all_elements_of_category_2, parameterName=code_block_19)
code_block_20 = CodeBlock { "Type Name"; }
getParameterValueByName_9 = Element.GetParameterValueByName(element=getParameterValueByName_8, parameterName=code_block_20)
groupByKey_4 = List.GroupByKey(list=all_elements_of_category_2, keys=getParameterValueByName_9)
code_block_21 = CodeBlock(list=groupByKey_4.groups) { list [5]; }
watch_2 = Watch(code_block_21)
code_block_22 = CodeBlock { 13; }
addInsulation_4 = Custom[Element.AddInsulation](Elements=watch_2, InsulationType=code_block, Thickness=code_block_22)
