# Dynamo graph INSULATION_pipe+fitting all.dyn (Dynamo 1.3.3.4111)

categories = Categories("PipeFitting")
all_elements_of_category = ElementsOfCategory(categories)
watch = Watch(all_elements_of_category)
element_types = ElementTypes("PipeInsulationType")
all_elements_of_type = ElementsOfType(element_types)
code_block = CodeBlock(list=all_elements_of_type) { list [1]; }
code_block_2 = CodeBlock { 20; }
addInsulation = Custom[Element.AddInsulation](Elements=watch, InsulationType=code_block, Thickness=code_block_2)  # Adds insulation to pipe or duct networks
watch_2 = Watch(addInsulation.Succeeded)
code_block_3 = CodeBlock { "Type Name"; }
getParameterValueByName = Element.GetParameterValueByName(element=all_elements_of_type, parameterName=code_block_3)
element_types_2 = ElementTypes("Pipe")
all_elements_of_type_2 = ElementsOfType(element_types_2)
code_block_4 = CodeBlock { "Type Name"; }
getParameterValueByName_2 = Element.GetParameterValueByName(element=all_elements_of_type_2, parameterName=code_block_4)
addInsulation_2 = Custom[Element.AddInsulation](Elements=all_elements_of_type_2, InsulationType=code_block, Thickness=code_block_2)
