# Dynamo graph LEVEL BY NAME AND ELEVATION.dyn (Dynamo 1.3.0.875)

file_path = Filename("C:\Users\System-03\Desktop\LEVEL AND NAME.xls")
fromPath = FileObject(file_path)  # "File.FromPath"
code_block = CodeBlock { "LE"; }
boolean = BoolSelector(true)
readFromFile = Excel.ReadFromFile(file=fromPath, sheetName=code_block, readAsStrings=boolean)
transpose = List.Transpose(readFromFile)
number = DoubleInput(1)
getItemAtIndex = List.GetItemAtIndex(list=transpose, index=number)
ELEVATION = Watch(getItemAtIndex)
transpose_2 = List.Transpose(readFromFile)
number_2 = DoubleInput(0)
getItemAtIndex_2 = List.GetItemAtIndex(list=transpose_2, index=number_2)
NAME = Watch(getItemAtIndex_2)
byElevationAndName = Level.ByElevationAndName(ELEVATION, NAME)
