# Dynamo graph NWC EXPORT.dyn (Dynamo 1.3.2.2480)

directory_path = Directory("C:\Users\System-04\Desktop\New folder")
fromPath = DirectoryObject(directory_path)  # "Directory.FromPath"
code_block = CodeBlock(a=fromPath) { a; }
string_from_object = FromObject(code_block)
views = Views("3D-Fire Pump")
boolean = BoolSelector(false)
n3d_views_to_nwc_export = Custom[3D Views To NWC Export](Directory_Name=string_from_object, List_Of_Views=views, Boolean=boolean)  # This Node can export a list of 3d Views.
