# Dynamo graph PIPE NETWORK BY CAD LAYOUT.dyn (Dynamo 1.3.3.4111)

select_model_elements = DSModelElementsSelection()

# group: CWS
geometry = Element.Geometry(select_model_elements)
watch = Watch(geometry)
code_block = CodeBlock { "CWS-1"; }
curvesFromCADLayers = CAD.CurvesFromCADLayers(select_model_elements, code_block)
watch_2 = Watch(curvesFromCADLayers)
code_block_2 = CodeBlock(list=watch_2) { list[0]; }
element_types = ElementTypes("PipeType")
all_elements_of_type = ElementsOfType(element_types)
code_block_3 = CodeBlock(list=all_elements_of_type) { list[1]; }
element_types_2 = ElementTypes("PipingSystemType")
all_elements_of_type_2 = ElementsOfType(element_types_2)
code_block_4 = CodeBlock(list=all_elements_of_type_2) { list[4]; }
levels = Levels("2.GROUND FLOOR FFL")
number = DoubleInput(32)
byLines = Custom[Pipe.ByLines](Lines=code_block_2, PipeType=code_block_3, SystemType=code_block_4, Level=levels, Diameter=number)  # Creates a pipe by Line, PipeType, SystemType, Level and Diameter
byMEPCurves = Custom[Elbow.ByMEPCurves]()  # Takes in a list of MEPCurves (pipe, duct, cable tray, conduit) and will attempt to create elbows where possible. A margin can be entered for max distance between connectors; unwired: MEPCurves
code_block_5 = CodeBlock { "Type Name"; }
getParameterValueByName = Element.GetParameterValueByName(element=all_elements_of_type, parameterName=code_block_5)
watch_3 = Watch(getParameterValueByName)
code_block_6 = CodeBlock { "Type Name"; }
getParameterValueByName_2 = Element.GetParameterValueByName(element=all_elements_of_type_2, parameterName=code_block_6)
watch_4 = Watch(getParameterValueByName_2)

# group: HWS
geometry_2 = Element.Geometry(select_model_elements)
watch_5 = Watch(geometry_2)
element_types_3 = ElementTypes("PipingSystemType")
all_elements_of_type_3 = ElementsOfType(element_types_3)
code_block_7 = CodeBlock { "Type Name"; }
getParameterValueByName_3 = Element.GetParameterValueByName(element=all_elements_of_type_3, parameterName=code_block_7)
watch_6 = Watch(getParameterValueByName_3)
element_types_4 = ElementTypes("PipeType")
all_elements_of_type_4 = ElementsOfType(element_types_4)
code_block_8 = CodeBlock { "Type Name"; }
getParameterValueByName_4 = Element.GetParameterValueByName(element=all_elements_of_type_4, parameterName=code_block_8)
watch_7 = Watch(getParameterValueByName_4)
code_block_9 = CodeBlock { "hws"; }
curvesFromCADLayers_2 = CAD.CurvesFromCADLayers(select_model_elements, code_block_9)
watch_8 = Watch(curvesFromCADLayers_2)
code_block_10 = CodeBlock(list=watch_8) { list[0]; }
code_block_11 = CodeBlock(list=all_elements_of_type_4) { list[1]; }
code_block_12 = CodeBlock(list=all_elements_of_type_3) { list[3]; }
levels_2 = Levels("2.GROUND FLOOR FFL")
number_2 = DoubleInput(32)
byLines_2 = Custom[Pipe.ByLines](Lines=code_block_10, PipeType=code_block_11, SystemType=code_block_12, Level=levels_2, Diameter=number_2)
byMEPCurves_2 = Custom[Elbow.ByMEPCurves]()  # unwired: MEPCurves

# group: HWR
geometry_3 = Element.Geometry(select_model_elements)
watch_9 = Watch(geometry_3)
element_types_5 = ElementTypes("PipingSystemType")
all_elements_of_type_5 = ElementsOfType(element_types_5)
code_block_13 = CodeBlock { "Type Name"; }
getParameterValueByName_5 = Element.GetParameterValueByName(element=all_elements_of_type_5, parameterName=code_block_13)
watch_10 = Watch(getParameterValueByName_5)
element_types_6 = ElementTypes("PipeType")
all_elements_of_type_6 = ElementsOfType(element_types_6)
code_block_14 = CodeBlock { "Type Name"; }
getParameterValueByName_6 = Element.GetParameterValueByName(element=all_elements_of_type_6, parameterName=code_block_14)
watch_11 = Watch(getParameterValueByName_6)
code_block_15 = CodeBlock { "HWR"; }
curvesFromCADLayers_3 = CAD.CurvesFromCADLayers(select_model_elements, code_block_15)
watch_12 = Watch(curvesFromCADLayers_3)
code_block_16 = CodeBlock(list=watch_12) { list[0]; }
code_block_17 = CodeBlock(list=all_elements_of_type_6) { list[1]; }
code_block_18 = CodeBlock(list=all_elements_of_type_5) { list[9]; }
levels_3 = Levels("2.GROUND FLOOR FFL")
number_3 = DoubleInput(32)
byLines_3 = Custom[Pipe.ByLines](Lines=code_block_16, PipeType=code_block_17, SystemType=code_block_18, Level=levels_3, Diameter=number_3)
byMEPCurves_3 = Custom[Elbow.ByMEPCurves]()  # unwired: MEPCurves

renameFamilyType = Custom[FamilyManager.RenameFamilyType]()  # Searches every family type for the given (sub)string and replace that the (sub)string with the replace string (only works in Family Editor); unwired: Search, Replace
select_model_element = DSModelElementSelection()  # 1 picked in the model
select_model_element_2 = DSModelElementSelection()  # 1 picked in the model
byMEPCurves_4 = Custom[MEPFitting.ByMEPCurves](MEPCurve1=select_model_element, MEPCurve2=select_model_element_2)  # Creates a UnionFitting or ElbowFitting by 2 MEPCurves (Ducts, Cable Trays, Pipes or Conduits). The output may not always be all the fittings created as Revit sometimes creates extra transition fittings outside of the node transactions.
