# Dynamo graph PLACING FAMILY ON CURVE+FAMILY LIST ON EXCEL.dyn (Dynamo 1.2.2.373)

file_path = Filename("..\..\x%20xz%20xz%20x%20xz%20zx%20x.xlsx")
code_block = CodeBlock { "FAMILY DETAIL"; }
number = DoubleInput(0)
number_2 = DoubleInput(0)
family_types = FamilyTypes("M_Downlight - Strip:0600mm - 277V")
select_model_element = DSModelElementSelection()  # 1 picked in the model
curves = Element.Curves(select_model_element)
number_3 = DoubleInput(0.1)
number_4 = DoubleInput(1)
number_5 = DoubleInput(0.1)
range = Range(start=number_3, end=number_4, step=number_5, lacing=CrossProduct)
pointAtParameter = Curve.PointAtParameter(curve=curves, param=range, lacing=Longest)
byPoint = FamilyInstance.ByPoint(familyType=family_types, point=pointAtParameter)
number_6 = DoubleInput(45)
setRotation = FamilyInstance.SetRotation(familyInstance=byPoint, degree=number_6)
name = Family.Name(setRotation)
watch = Watch(name)
writeToFile = Excel.WriteToFile(filePath=file_path, sheetName=code_block, startRow=number, startCol=number_2, data=watch)
watch_2 = Watch(setRotation)
