# Dynamo graph PLACING FAMILY ON CURVE.dyn (Dynamo 1.2.2.373)

family_types = FamilyTypes("M_Downlight - Strip:0600mm - 277V")
select_model_element = DSModelElementSelection()  # 1 picked in the model
curves = Element.Curves(select_model_element)
number = DoubleInput(1)
number_2 = DoubleInput(5)
number_3 = DoubleInput(1)
range = Range(start=number, end=number_2, step=number_3, lacing=CrossProduct)
pointAtParameter = Curve.PointAtParameter(curve=curves, param=range, lacing=Longest)
byPoint = FamilyInstance.ByPoint(familyType=family_types, point=pointAtParameter)
number_4 = DoubleInput(90)
setRotation = FamilyInstance.SetRotation(familyInstance=byPoint, degree=number_4)
