# Dynamo graph PLACING MANHOLE WITH CO-ORDINATES AND LEVELS.dyn (Dynamo 1.2.2.373)

string = StringInput("ic")
file_path = Filename("C:\Users\IAA\Desktop\extra\MANHOLE LOCATION.xlsx")
fromPath = FileObject(file_path)  # "File.FromPath"
string_2 = StringInput("Sheet1")
boolean = BoolSelector(false)
readFromFile = Excel.ReadFromFile(file=fromPath, sheetName=string_2, readAsStrings=boolean)
transpose = List.Transpose(readFromFile)
number = DoubleInput(0)
getItemAtIndex = List.GetItemAtIndex(list=transpose, index=number)
byFamilyNameAndTypeName = FamilyType.ByFamilyNameAndTypeName(string, getItemAtIndex)
transpose_2 = List.Transpose(readFromFile)
number_2 = DoubleInput(1)
getItemAtIndex_2 = List.GetItemAtIndex(list=transpose_2, index=number_2)
transpose_3 = List.Transpose(readFromFile)
number_3 = DoubleInput(2)
getItemAtIndex_3 = List.GetItemAtIndex(list=transpose_3, index=number_3)
transpose_4 = List.Transpose(readFromFile)
number_4 = DoubleInput(3)
getItemAtIndex_4 = List.GetItemAtIndex(list=transpose_4, index=number_4)
byCoordinates = FamilyInstance.ByCoordinates(byFamilyNameAndTypeName, getItemAtIndex_2, getItemAtIndex_3, getItemAtIndex_4)
watch = Watch(byCoordinates)
string_3 = StringInput("DEPTH")
transpose_5 = List.Transpose(readFromFile)
number_5 = DoubleInput(4)
getItemAtIndex_5 = List.GetItemAtIndex(list=transpose_5, index=number_5)
transpose_6 = List.Transpose(readFromFile)
number_6 = DoubleInput(5)
getItemAtIndex_6 = List.GetItemAtIndex(list=transpose_6, index=number_6)
mul = getItemAtIndex_5 * getItemAtIndex_6
watch_2 = Watch(mul)
setParameterByName = Element.SetParameterByName(element=watch, parameterName=string_3, value=watch_2)
watch_3 = Watch(byFamilyNameAndTypeName)
