# Dynamo graph PRINT MULTIPLE SCHEDULE IN EXCEL.dyn (Dynamo 1.3.3.4111)

file_path = Filename("C:\Users\IAA\Desktop\sch")
code_block = CodeBlock { "Mechanical Equipment Schedule"; }
code_block_2 = CodeBlock { "Pipe Accessory Schedule"; }
create = List.Create(code_block, code_block_2)
number = DoubleInput(0)
number_2 = DoubleInput(0)
code_block_3 = CodeBlock { "Mechanical Equipment Schedule"; }
code_block_4 = CodeBlock { "Pipe Accessory Schedule"; }
create_2 = List.Create(code_block_3, code_block_4)
boolean = BoolSelector(false)
getData = Revit.Schedule.GetData(create_2, boolean)
watch = Watch(getData)
writeToFile = Excel.WriteToFile(filePath=file_path, sheetName=create, startRow=number, startCol=number_2, data=watch)
watch_2 = Watch(writeToFile)
