# Dynamo graph PRINT SCHEDULE IN EXCEL.dyn (Dynamo 1.3.2.2480)

getScheduleData = Custom[bimorph.GetScheduleData]()  # Gets all the table data from a given schedule as strings; unwired: scheduleViewOrName
file_path = Filename("C:\Users\System-04\Desktop\SDFSDF - Copy.xlsx")
code_block = CodeBlock { "pipe fiting"; }
number = DoubleInput(0)
number_2 = DoubleInput(0)
code_block_2 = CodeBlock { "Pipe Fitting Schedule"; }
boolean = BoolSelector(false)
getData = Revit.Schedule.GetData(code_block_2, boolean)
watch = Watch(getData)
writeToFile = Excel.WriteToFile(filePath=file_path, sheetName=code_block, startRow=number, startCol=number_2, data=watch, overWrite=boolean)
watch_2 = Watch(writeToFile)
