# Dynamo graph REPLACING FAMILY BY CAD AND POINT TRANSLATION.dyn (Dynamo 1.3.3.4111)

family_types = FamilyTypes("M_Lighting Switches:Single Pole")
select_face = DSFaceSelection()  # 1 picked in the model
byGeometry = ImportInstance.ByGeometry(select_face)
faces = Element.Faces(byGeometry)
flatten = Flatten(faces)
select_model_element = DSModelElementSelection()  # 1 picked in the model
code_block = CodeBlock { "EL-POWER"; }
curvesFromCADLayers = CAD.CurvesFromCADLayers(select_model_element, code_block)
watch = Watch(curvesFromCADLayers.out0)
pointAtParameter = Curve.PointAtParameter(curve=watch)
ZAxis = Vector.ZAxis()
code_block_2 = CodeBlock { 1200; }
translate = CoordinateSystem.Translate(pointAtParameter, ZAxis, code_block_2)
byFace = FamilyInstance.ByFace(family_types, flatten, translate, ZAxis)
number = DoubleInput(1)
pointAtParameter_2 = Surface.PointAtParameter(surface=select_face, u=number, v=number)
geometry = Element.Geometry(select_model_element)
watch_2 = Watch(curvesFromCADLayers.out1)
watch_3 = Watch(pointAtParameter)
XAxis = Vector.XAxis()
