# Dynamo graph REPLACING FAMILY NAME.dyn (Dynamo 1.2.2.373)

element_types = ElementTypes("Family")
all_elements_of_type = ElementsOfType(element_types)
string_from_object = FromObject(all_elements_of_type)
code_block = CodeBlock { "P&D"; }
contains = String.Contains(str=string_from_object, searchFor=code_block)
filterByBoolMask = List.FilterByBoolMask(list=all_elements_of_type, mask=contains)
watch = Watch(filterByBoolMask.out)
watch_2 = Watch(filterByBoolMask.in)
name = Element.Name(watch_2)
code_block_2 = CodeBlock { "MEP"; }
replace = String.Replace(str=name, searchFor=code_block, replaceWith=code_block_2)
setName = Custom[Element.SetName](element=filterByBoolMask.in, name=replace)  # Gets the name of a given Revit element
