# Dynamo graph Rename family names.dyn (Dynamo 1.3.2.2480)

element_types = ElementTypes("Family")
all_elements_of_type = ElementsOfType(element_types)
string_from_object = FromObject(all_elements_of_type)
code_block = CodeBlock { "This script allows you to rename family names"; }
code_block_2 = CodeBlock { "ok set the values"; }
code_block_3 = CodeBlock { "Search this text >>"; }
code_block_4 = CodeBlock { "Type here.."; }
ui_textbox_data = Custom[UI.TextBox Data](InputName=code_block_3, DefaultText=code_block_4)  # Create Data for TextBox input in UI.MultipleInputForm ++ . Check out www.data-shapes.net for more informations
code_block_5 = CodeBlock { "And replace it with >>"; }
code_block_6 = CodeBlock { "Type here.."; }
ui_textbox_data_2 = Custom[UI.TextBox Data](InputName=code_block_5, DefaultText=code_block_6)
create = List.Create(ui_textbox_data, ui_textbox_data_2)
boolean = BoolSelector(true)
code_block_7 = CodeBlock { "cancel"; }
number = DoubleInput(700)
ui_multipleinputform = Custom[UI.MultipleInputForm ++](Description_optional=code_block, ButtonText_optional=code_block_2, Inputs=create, Toggle=boolean, CancelButtonText_optional=code_block_7, MaxHeight_optional=number, Width_optional=number)  # Create a form with multiple inputs. see www.data-shapes.net for tutorials and infos!
code_block_8 = CodeBlock { 0; }
getItemAtIndex = List.GetItemAtIndex(list=ui_multipleinputform.User_Inputs, index=code_block_8)
boolean_2 = BoolSelector(true)
contains = String.Contains(str=string_from_object, searchFor=getItemAtIndex, ignoreCase=boolean_2)
filterByBoolMask = List.FilterByBoolMask(list=all_elements_of_type, mask=contains)
name = Element.Name(filterByBoolMask.in)
passthrough = Custom[Passthrough](passThrough=getItemAtIndex, waitFor=filterByBoolMask.in)  # Forces a sequential order of execution. The node wired into the output of the Passthrough node will be executed *after* the node wired into the waitFor input (e.g. important for some Revit operations). The value of the passThrough input will be passed on to the node wired into the output port of the Passthrough node.
code_block_9 = CodeBlock { 1; }
getItemAtIndex_2 = List.GetItemAtIndex(list=ui_multipleinputform.User_Inputs, index=code_block_9)
replace = String.Replace(str=name, searchFor=passthrough, replaceWith=getItemAtIndex_2)
setName = Custom[Element.SetName](element=filterByBoolMask.in, name=replace)  # Gets the name of a given Revit element
watch = Watch(setName.Success)
watch_2 = Watch(setName.Fail)
