# Dynamo graph SETTING PARAMETER .dyn (Dynamo 1.3.0.875)

categories = Categories("MEPSpaces")
all_elements_of_category = ElementsOfCategory(categories)
string = StringInput("Name")
string_2 = StringInput("living room")
setParameterByName = Element.SetParameterByName(element=all_elements_of_category, parameterName=string, value=string_2)
getParameterValueByName = Element.GetParameterValueByName(element=all_elements_of_category, parameterName=string)
string_3 = StringInput("Number")
string_4 = StringInput("301")
setParameterByName_2 = Element.SetParameterByName(element=all_elements_of_category, parameterName=string_3, value=string_4)
categories_2 = Categories("MechanicalEquipment")
all_elements_of_category_2 = ElementsOfCategory(categories_2)
watch = Watch(all_elements_of_category_2)
code_block = CodeBlock(list=watch) { list[0]; list[1]; }
string_5 = StringInput("Capacity")
getParameterValueByName_2 = Element.GetParameterValueByName(element=code_block.out0, parameterName=string_5)
string_6 = StringInput("Offset")
number = DoubleInput(3000)
setParameterByName_3 = Element.SetParameterByName(element=code_block.out0, parameterName=string_6, value=number)
code_block_2 = CodeBlock { "Capacity"; }
string_7 = StringInput("Capacity")
setParameterByName_4 = Element.SetParameterByName(element=code_block.out1, parameterName=code_block_2, value=string_7)
