# Dynamo graph SETTING PARAMETER VALUE.dyn (Dynamo 1.3.3.4111)

string = StringInput("QAF_QDC_MEP_PA_BALL VALVE")
byName = Family.ByName(string)
types = Family.Types(byName)
get_family_parameter = FamilyInstanceParameters(types)
get_family_parameter_2 = FamilyInstanceParameters(types)
get_family_parameter_3 = FamilyInstanceParameters(types)
create = List.Create(get_family_parameter, get_family_parameter_2, get_family_parameter_3)
string_2 = StringInput("GATE VALVE")
string_3 = StringInput("D20")
string_4 = StringInput("2000")
create_2 = List.Create(string_2, string_3, string_4)
setParameterByName = Element.SetParameterByName(element=types, parameterName=create, value=create_2)
family_types = FamilyTypes("QAF_QDC_MEP_ME_WATER TANK:PWT-02")
