# Dynamo graph SHEET CREATION READ EXCEL AND WRITE TO EXCEL.dyn (Dynamo 1.3.2.2480)

file_path = Filename("..\..\For Dynamo.xlsx")
fromPath = FileObject(file_path)  # "File.FromPath"
code_block = CodeBlock { "SHEET CREATION"; }
boolean = BoolSelector(true)
readFromFile = Excel.ReadFromFile(file=fromPath, sheetName=code_block, readAsStrings=boolean)
transpose = List.Transpose(readFromFile)
number = DoubleInput(0)
getItemAtIndex = List.GetItemAtIndex(list=transpose, index=number)
sheet_name = Watch(getItemAtIndex)
transpose_2 = List.Transpose(readFromFile)
number_2 = DoubleInput(1)
getItemAtIndex_2 = List.GetItemAtIndex(list=transpose_2, index=number_2)
sheet_number = Watch(getItemAtIndex_2)
family_types = FamilyTypes("A1 metric:A1 metric")
views = Views()
views_2 = Views()
views_3 = Views()
views_4 = Views()
create = List.Create(views, views_2, views_3, views_4)
byNameNumberTitleBlockAndView = Sheet.ByNameNumberTitleBlockAndView(sheetName=sheet_name, sheetNumber=sheet_number, titleBlockFamilyType=family_types, view=create)  # frozen
file_path_2 = Filename("C:\Users\System-04\Desktop\For DynamoEREWREREWRWERWERWER.xlsx")
code_block_2 = CodeBlock { "SHEET N & N"; }
code_block_3 = CodeBlock { 1; }
code_block_4 = CodeBlock { 0; }
create_2 = List.Create(sheet_name, sheet_number)
transpose_3 = List.Transpose(create_2)
boolean_2 = BoolSelector(false)
writeToFile = Excel.WriteToFile(filePath=file_path_2, sheetName=code_block_2, startRow=code_block_3, startCol=code_block_4, data=transpose_3, overWrite=boolean_2)
