# Dynamo graph SHEET CREATION READ EXCEL.dyn (Dynamo 1.2.2.373)

file_path = Filename("..\SHEET%20NAME%20&%20NUMBER.xlsx")
fromPath = FileObject(file_path)  # "File.FromPath"
code_block = CodeBlock { "SNN"; }
boolean = BoolSelector(true)
readFromFile = Excel.ReadFromFile(file=fromPath, sheetName=code_block, readAsStrings=boolean)
transpose = List.Transpose(readFromFile)
number = DoubleInput(0)
getItemAtIndex = List.GetItemAtIndex(list=transpose, index=number)
sheet_name = Watch(getItemAtIndex)
transpose_2 = List.Transpose(readFromFile)
number_2 = DoubleInput(1)
getItemAtIndex_2 = List.GetItemAtIndex(list=transpose_2, index=number_2)
sheet_number = Watch(getItemAtIndex_2)
family_types = FamilyTypes("A1 metric:A1 metric")
views = Views("1 - Floor Plan Pump Room")
views_2 = Views("PUMP ROOM VIEW")
views_3 = Views("Electric Pmp")
views_4 = Views("Deisel Pump")
create = List.Create(views, views_2, views_3, views_4)
byNameNumberTitleBlockAndView = Sheet.ByNameNumberTitleBlockAndView(sheetName=sheet_name, sheetNumber=sheet_number, titleBlockFamilyType=family_types, view=create)
