# Dynamo graph SHEET NAME & NUMBER ON EXCEL.dyn (Dynamo 1.2.2.373)

number = DoubleInput(1)
getItemAtIndex = List.GetItemAtIndex(index=number)  # unwired: list
watch = Watch(getItemAtIndex)
number_2 = DoubleInput(0)
getItemAtIndex_2 = List.GetItemAtIndex(index=number_2)  # unwired: list
watch_2 = Watch(getItemAtIndex_2)
file_path = Filename("..\BVNGKJ")
code_block = CodeBlock { "GXFGFXGXF"; }
number_3 = DoubleInput(0)
number_4 = DoubleInput(0)

# group: SHEET NAMES & NUMBERS
sheet_name_numbers = CodeBlock { "FLOOR PLAN"; "PUMP ROOM"; "ELECTRIC PUMP"; "DEISEL PUMP"; "FP01"; "FP02"; "FP03"; "FP04"; }
sheet_names = List.Create(sheet_name_numbers.out0, sheet_name_numbers.out1, sheet_name_numbers.out2, sheet_name_numbers.out3)
sheet_numbers = List.Create(sheet_name_numbers.out4, sheet_name_numbers.out5, sheet_name_numbers.out6, sheet_name_numbers.out7)

watch_3 = Watch(sheet_names)
transpose = List.Transpose(watch_3)
watch_4 = Watch(transpose)
watch_5 = Watch(sheet_numbers)
transpose_2 = List.Transpose(watch_5)
watch_6 = Watch(transpose_2)
create = List.Create(watch_4, watch_6)
watch_7 = Watch(create)
boolean = BoolSelector(false)
writeToFile = Excel.WriteToFile(filePath=file_path, sheetName=code_block, startRow=number_3, startCol=number_4, data=watch_7, overWrite=boolean)
