# Dynamo graph TRANFER DATA TO ANOTHER PARAMETER.dyn (Dynamo 1.3.2.2480)

categories = Categories("PipeAccessory")
all_elements_of_category = ElementsOfCategory(categories)
create = List.Create(all_elements_of_category)
string = StringInput("TAG")
string_2 = StringInput("tags")
getParameterValueByName = Element.GetParameterValueByName(element=create, parameterName=string_2)
setParameterByName = Element.SetParameterByName(element=create, parameterName=string, value=getParameterValueByName)  # frozen
file_path = Filename(".\new export.xlsx")
code_block = CodeBlock { "Sheet1"; }
code_block_2 = CodeBlock { 0; }
code_block_3 = CodeBlock { "Pipe Accessory Schedule"; }
boolean = BoolSelector(false)
getData = Revit.Schedule.GetData(code_block_3, boolean)
writeToFile = Excel.WriteToFile(filePath=file_path, sheetName=code_block, startRow=code_block_2, startCol=code_block_2, data=getData)  # frozen
file_path_2 = Filename(".\new export.xlsx")
fromPath = FileObject(file_path_2)  # "File.FromPath"
code_block_4 = CodeBlock { "Sheet1"; }
boolean_2 = BoolSelector(false)
readFromFile = Excel.ReadFromFile(file=fromPath, sheetName=code_block_4, readAsStrings=boolean_2)
transpose = List.Transpose(readFromFile)
code_block_5 = CodeBlock { 1; }
getItemAtIndex = List.GetItemAtIndex(list=transpose, index=code_block_5)
watch = Watch(getItemAtIndex)
transpose_2 = List.Transpose(readFromFile)
code_block_6 = CodeBlock { 2; }
getItemAtIndex_2 = List.GetItemAtIndex(list=transpose_2, index=code_block_6)
watch_2 = Watch(getItemAtIndex_2)
transpose_3 = List.Transpose(readFromFile)
code_block_7 = CodeBlock { 0; }
getItemAtIndex_3 = List.GetItemAtIndex(list=transpose_3, index=code_block_7)
watch_3 = Watch(getItemAtIndex_3)
