# Dynamo graph TUNNEL.dyn (Dynamo 1.3.2.2480)

string = StringInput("FinalSegment")
byName = FamilyType.ByName(string)
select_model_element = DSModelElementSelection()  # 1 picked in the model
curves = Element.Curves(select_model_element)
code_block = CodeBlock { "Length"; }
getParameterValueByName = Element.GetParameterValueByName(element=select_model_element, parameterName=code_block)
watch = Watch(getParameterValueByName)
code_block_2 = CodeBlock(a=watch) { a; a/2000; }
pointsAtEqualSegmentLength = Curve.PointsAtEqualSegmentLength(curve=curves, divisions=code_block_2.out1)
byPoint = FamilyInstance.ByPoint(familyType=byName, point=pointsAtEqualSegmentLength)
pointsDivideByMaxDistance = Geometry.Curve.PointsDivideByMaxDistance()  # unwired: arg0, arg1
watch_2 = Watch(curves)
watch_3 = Watch(pointsAtEqualSegmentLength)
code_block_3 = CodeBlock { 5; }
geometry = Element.Geometry(select_model_element)
watch_4 = Watch(code_block_2.out1)
select_model_element_2 = DSModelElementSelection()  # 1 picked in the model
code_block_4 = CodeBlock { "Road Length"; }
code_block_5 = CodeBlock(b=watch) { b; b-2000; }
setParameterByName = Element.SetParameterByName(element=select_model_element_2, parameterName=code_block_4, value=code_block_5.out1)
curves_2 = Element.Curves(select_model_element)
code_block_6 = CodeBlock { 1000; }

# group: pipe curve
code_block_7 = CodeBlock { 3000; }
offset = Curve.Offset(curve=curves_2, distance=code_block_7)
ZAxis = Vector.ZAxis()
translate = Geometry.Translate(geometry=offset, direction=ZAxis, distance=code_block_6)

element_types = ElementTypes("PipeType")
all_elements_of_type = ElementsOfType(element_types)
watch_5 = Watch(all_elements_of_type)
code_block_8 = CodeBlock(list=watch_5) { list[0]; }
element_types_2 = ElementTypes("PipingSystemType")
all_elements_of_type_2 = ElementsOfType(element_types_2)
watch_6 = Watch(all_elements_of_type_2)
code_block_9 = CodeBlock(list=watch_6) { list[0]; }
levels = Levels("Level 1")
number = DoubleInput(150)
byLines = Custom[Pipe.ByLines](Lines=translate, PipeType=code_block_8, SystemType=code_block_9, Level=levels, Diameter=number)  # Creates a pipe by Line, PipeType, SystemType, Level and Diameter
code_block_10 = CodeBlock { -3000; }
offset_2 = Curve.Offset(curve=curves_2, distance=code_block_10)
ZAxis_2 = Vector.ZAxis()
translate_2 = Geometry.Translate(geometry=offset_2, direction=ZAxis_2, distance=code_block_6)
element_types_3 = ElementTypes("DuctType")
all_elements_of_type_3 = ElementsOfType(element_types_3)
watch_7 = Watch(all_elements_of_type_3)
code_block_11 = CodeBlock(list=watch_7) { list[0]; }
element_types_4 = ElementTypes("MechanicalSystemType")
all_elements_of_type_4 = ElementsOfType(element_types_4)
watch_8 = Watch(all_elements_of_type_4)
code_block_12 = CodeBlock(list=watch_8) { list[0]; }
levels_2 = Levels("Level 1")
number_2 = DoubleInput(1000)
number_3 = DoubleInput(500)
byLines_2 = Custom[DuctRectangular.ByLines](Lines=translate_2, DuctType=code_block_11, MechanicalSystemType=code_block_12, Level=levels_2, Width=number_2, Height=number_3)  # Create ducts by Lines, DuctType, MechanicalFittingType, Level, Width and Height
