# Dynamo graph WHILE LOOP CODE BLOCK.dyn (Dynamo 1.3.2.2480)

code_block = CodeBlock()
# ---------- code_block.designscript (13 lines) ----------
d= [Imperative]
{
i=0;
xlist={};
while (i < 9)
{
xlist={i};

i= i + 1;
}
return=xlist;

};
# ----------------------------------------
watch = Watch(code_block)
code_block_2 = CodeBlock { 0; }
getItemAtIndex = List.GetItemAtIndex(list=code_block, index=code_block_2)
watch_2 = Watch(getItemAtIndex)
code_block_3 = CodeBlock()
# ---------- code_block_3.designscript (11 lines) ----------
d= [Imperative]
{
sum = 0;
x = 0;
while (x < 10)
{
sum = sum + x;
x = x + 1;
}
return=sum;
};
# ----------------------------------------
watch_3 = Watch(code_block_3)
