# Dynamo graph Wall Finishes by Room.dyn (Dynamo 1.3.0.875)

categories = Categories("Rooms")
all_elements_of_category = ElementsOfCategory(categories)
code_block = CodeBlock { "Wall Name"; "Ceiling Height"; }
wall_finishes_by_room = Custom[Wall Finishes by Room](Rooms=all_elements_of_category, Wall_Finish_param=code_block.out0, Ceiling_Height_param=code_block.out1)  # Place wall finishes with the info contained in room parameters
