# Dynamo graph dynamo for comparison.dyn (Dynamo 2.1.0.7500)

# group: Getting Grid lines and taking intersection lines of it
categories = Categories("OST_Grids")
all_elements_of_category = ElementsOfCategory(Category=categories)
code_block = CodeBlock { "Name"; }
getParameterValueByName = Element.GetParameterValueByName(element=all_elements_of_category, parameterName=code_block)
toNumber = String.ToNumber(str=getParameterValueByName)
isNull = Object.IsNull(obj=toNumber)
filterByBoolMask = List.FilterByBoolMask(list=all_elements_of_category, mask=isNull)
curve = Grid.Curve(grid=filterByBoolMask.in)
curve_2 = Grid.Curve(grid=filterByBoolMask.out)
intersect = Geometry.Intersect(geometry=curve, other=curve_2, lacing=CrossProduct)
code_block_2 = CodeBlock { 2; }
flatten = List.Flatten(list=intersect, amt=code_block_2)

# group: Getting topography2
select_model_element = DSModelElementSelection()  # 1 picked in the model
mesh = Topography.Mesh(topography=select_model_element)
vertexPositions = Mesh.VertexPositions(mesh=mesh)
faceIndices = Mesh.FaceIndices(mesh=mesh)
A = IndexGroup.A(indexGroup=faceIndices)
B = IndexGroup.B(indexGroup=faceIndices)
C = IndexGroup.C(indexGroup=faceIndices)
code_block_3 = CodeBlock(a=A, b=B, c=C) { List.Transpose([a,b,c]); }
getItemAtIndex = List.GetItemAtIndex(list=vertexPositions, index=code_block_3)
byPerimeterPoints = Surface.ByPerimeterPoints(points=getItemAtIndex)
byJoinedSurfaces = PolySurface.ByJoinedSurfaces(surfaces=byPerimeterPoints)

# group: Getting Topography1
select_model_element_2 = DSModelElementSelection()  # 1 picked in the model
mesh_2 = Topography.Mesh(topography=select_model_element_2)
vertexPositions_2 = Mesh.VertexPositions(mesh=mesh_2)
faceIndices_2 = Mesh.FaceIndices(mesh=mesh_2)
A_2 = IndexGroup.A(indexGroup=faceIndices_2)
B_2 = IndexGroup.B(indexGroup=faceIndices_2)
C_2 = IndexGroup.C(indexGroup=faceIndices_2)
code_block_4 = CodeBlock(a=A_2, b=B_2, c=C_2) { List.Transpose([a,b,c]); }
getItemAtIndex_2 = List.GetItemAtIndex(list=vertexPositions_2, index=code_block_4)
byPerimeterPoints_2 = Surface.ByPerimeterPoints(points=getItemAtIndex_2)
byJoinedSurfaces_2 = PolySurface.ByJoinedSurfaces(surfaces=byPerimeterPoints_2)

# group: getting projected points
ZAxis = Vector.ZAxis()
project = Point.Project(point=flatten, baseGeometry=byJoinedSurfaces, projectionDirection=ZAxis)
flatten_2 = List.Flatten(list=project)
project_2 = Point.Project(point=flatten, baseGeometry=byJoinedSurfaces_2, projectionDirection=ZAxis)
flatten_3 = List.Flatten(list=project_2)
