# Dynamo graph getting value of linked rvt file.dyn (Dynamo 1.3.0.875)

element_types = ElementTypes("RevitLinkInstance")
all_elements_of_type = ElementsOfType(element_types)
categories = Categories("Walls")
ofCategory = Revit.LinkElement.OfCategory(all_elements_of_type, categories)
code_block = CodeBlock(list=ofCategory)
# ---------- code_block.designscript (2 lines) ----------
list[0
];
# ----------------------------------------
boolean = BoolSelector(false)
filterByBoolMask = List.FilterByBoolMask(list=code_block, mask=boolean)
string = StringInput("Length")
getParameterValueByName = Element.GetParameterValueByName(element=filterByBoolMask.out, parameterName=string)
