# Dynamo graph give value to parameters.dyn (Dynamo 1.2.2.373)

select_model_element = DSModelElementSelection()
string = StringInput("Mark")
getParameterValueByName = Element.GetParameterValueByName(element=select_model_element, parameterName=string)
categories = Categories("StructuralFoundation")
all_elements_of_category = ElementsOfCategory(categories)
watch = Watch(all_elements_of_category)
string_2 = StringInput("Comments")
string_3 = StringInput("manhole")
setParameterByName = Element.SetParameterByName(element=watch, parameterName=string_2, value=string_3)
location = FamilyInstance.Location(all_elements_of_category)
watch_2 = Watch(location)
string_from_object = FromObject(watch_2)
