# Dynamo graph if-else condition.dyn (Dynamo 1.3.3.4111)

select_model_element = DSModelElementSelection()  # 1 picked in the model
code_block = CodeBlock { "Diameter"; }
getParameterValueByName = Element.GetParameterValueByName(element=select_model_element, parameterName=code_block)
watch = Watch(getParameterValueByName)
select_model_element_2 = DSModelElementSelection()  # 1 picked in the model
code_block_2 = CodeBlock { "Diameter"; }
getParameterValueByName_2 = Element.GetParameterValueByName(element=select_model_element_2, parameterName=code_block_2)
watch_2 = Watch(getParameterValueByName_2)
code_block_3 = CodeBlock(watch, watch_2)
# ---------- code_block_3.designscript (13 lines) ----------
a;
b;
c= [Imperative]
{
if(a>b)
{
return=a;
}
else
{
return=b;
}
};
# ----------------------------------------
watch_3 = Watch(code_block_3.out2)
