# Dynamo graph insulation by size selection .dyn (Dynamo 1.3.2.2480)

element_types = ElementTypes("Pipe")
all_elements_of_type = ElementsOfType(element_types)
element_types_2 = ElementTypes("PipeInsulationType")
all_elements_of_type_2 = ElementsOfType(element_types_2)
code_block = CodeBlock(list=all_elements_of_type_2) { list[1]; }
code_block_2 = CodeBlock { "Diameter"; }
getParameterValueByName = Element.GetParameterValueByName(element=all_elements_of_type, parameterName=code_block_2)
convert_between_units = DynamoConvert(getParameterValueByName, conversionMetric=Length, conversionFrom=Feet, conversionTo=Millimeters)
watch = Watch(convert_between_units)
code_block_3 = CodeBlock { 50; }
le = watch <= code_block_3
code_block_4 = CodeBlock { 75; }
code_block_5 = CodeBlock { 30; }
if_ = If(test=le, true=code_block_4, false=code_block_5)
addInsulation = Custom[Element.AddInsulation](Elements=all_elements_of_type, InsulationType=code_block, Thickness=if_)  # Adds insulation to pipe or duct networks
lt = _ < _  # unwired: arg0, arg1
watch_2 = Watch(getParameterValueByName)
