# Dynamo graph placing family by curve point and parameter.dyn (Dynamo 1.3.3.4111)

select_model_elements = DSModelElementsSelection()  # 4 picked in the model
curves = Element.Curves(select_model_elements)
number = DoubleInput(2500)
levels = Levels("Level 1")
wall_types = WallTypes("Generic - 200mm")
byCurveAndHeight = Wall.ByCurveAndHeight(curve=curves, height=number, level=levels, wallType=wall_types)
watch = Watch(curves)
byFamilyType = FamilyInstance.ByFamilyType()  # unwired: arg0
family_types = FamilyTypes("QAF-QDC-MEP_SP_FIRE SPRINKLER PENDENT:SP-2")
all_elements_of_family_type = ElementsOfFamilyType(family_types)
select_model_element = DSModelElementSelection()  # 1 picked in the model
curves_2 = Element.Curves(select_model_element)
centerPoint = Circle.CenterPoint(curves_2)
watch_2 = Watch(centerPoint)
code_block = CodeBlock(list=watch_2) { list[0]; }
transpose = List.Transpose(code_block)
levels_2 = Levels("Level 1")
byPointAndLevel = FamilyInstance.ByPointAndLevel(familyType=family_types, point=centerPoint, level=levels_2)
getType = FamilyInstance.GetType(byPointAndLevel)
watch_3 = Watch(getType)
all_elements_of_family_type_2 = ElementsOfFamilyType(watch_3)
code_block_2 = CodeBlock { "Offset"; }
select_model_element_2 = DSModelElementSelection()  # 1 picked in the model
watch_4 = Watch(select_model_element_2)
code_block_3 = CodeBlock { "Height Offset From Level"; }
getParameterValueByName = Element.GetParameterValueByName(element=watch_4, parameterName=code_block_3)
watch_5 = Watch(getParameterValueByName)
code_block_4 = CodeBlock(watch_5) { a; c=Imperative; c=a+43.8; }  # unwired: arg1
watch_6 = Watch(code_block_4.out1)
setParameterByName = Element.SetParameterByName(element=all_elements_of_family_type_2, parameterName=code_block_2, value=watch_6)
