# Dynamo graph tagging from categories.dyn (Dynamo 1.3.0.875)

views = Views("GROUND FLOOR FFL +0.60 = 13.75 QND")
categories = Categories("DuctCurves")
all_elements_of_category = ElementsOfCategory(categories)
boolean = BoolSelector(false)
boolean_2 = BoolSelector(true)
code_block = CodeBlock { "Center"; }
code_block_2 = CodeBlock { "Center"; }
byElement = Tag.ByElement(views, all_elements_of_category, boolean, boolean_2, code_block, code_block_2)
