# Dynamo graph topography READ EXCEL.dyn (Dynamo 1.3.2.2480)

file_path = Filename("..\Downloads\topograpyh (1).xlsx")
fromPath = FileObject(file_path)  # "File.FromPath"
code_block = CodeBlock { "Sheet1"; }
boolean = BoolSelector(true)
readFromFile = Excel.ReadFromFile(file=fromPath, sheetName=code_block, readAsStrings=boolean)
watch = Watch(readFromFile)
byPoints = Topography.ByPoints(readFromFile)
