# Dynamo graph type & family name by excel.dyn (Dynamo 1.2.2.373)

boolean = BoolSelector(false)
file_path = Filename("..\..\MANHOLE%20LOCATION.xlsx")
fromPath = FileObject(file_path)  # "File.FromPath"
code_block = CodeBlock { "Sheet1"; }
readFromFile = Excel.ReadFromFile(file=fromPath, sheetName=code_block)
transpose = List.Transpose(readFromFile)
number = DoubleInput(1)
getItemAtIndex = List.GetItemAtIndex(list=transpose, index=number)
watch = Watch(getItemAtIndex)
transpose_2 = List.Transpose(readFromFile)
number_2 = DoubleInput(3)
getItemAtIndex_2 = List.GetItemAtIndex(list=transpose_2, index=number_2)
watch_2 = Watch(getItemAtIndex_2)
transpose_3 = List.Transpose(readFromFile)
number_3 = DoubleInput(2)
getItemAtIndex_3 = List.GetItemAtIndex(list=transpose_3, index=number_3)
watch_3 = Watch(getItemAtIndex_3)
string = StringInput("ic")
transpose_4 = List.Transpose(readFromFile)
number_4 = DoubleInput(0)
getItemAtIndex_4 = List.GetItemAtIndex(list=transpose_4, index=number_4)
watch_4 = Watch(getItemAtIndex_4)
byFamilyNameAndTypeName = FamilyType.ByFamilyNameAndTypeName(string, watch_4)
watch_5 = Watch(byFamilyNameAndTypeName)
byCoordinates = FamilyInstance.ByCoordinates(watch_5, getItemAtIndex, getItemAtIndex_3, getItemAtIndex_2)
type = FamilyInstance.Type(byCoordinates)
string_2 = StringInput("Depth")
file_path_2 = Filename("..\..\sfddgfgfgf.xlsx")
fromPath_2 = FileObject(file_path_2)  # "File.FromPath"
code_block_2 = CodeBlock { "Sheet1"; }
readFromFile_2 = Excel.ReadFromFile(file=fromPath_2, sheetName=code_block_2)
transpose_5 = List.Transpose(readFromFile_2)
number_5 = DoubleInput(0)
getItemAtIndex_5 = List.GetItemAtIndex(list=transpose_5, index=number_5)
watch_6 = Watch(getItemAtIndex_5)
transpose_6 = List.Transpose(readFromFile_2)
number_6 = DoubleInput(1)
getItemAtIndex_6 = List.GetItemAtIndex(list=transpose_6, index=number_6)
watch_7 = Watch(getItemAtIndex_6)
mul = watch_6 * watch_7
setParameterSetValueString = Custom[SetParameterSetValueString](Elements=type, ParameterName=string_2, Values=mul)  # Sets the parameters by strings. Useful for setting numerical values that are affected by Revit's internal unit conversion. Does not work for parameters that are stored as elementId
watch_8 = Watch(mul)
boolean_2 = BoolSelector(false)
getParameterAsValueString = Custom[GetParameterAsValueString]()  # Returns the parameter values without conversion to the revit internal unit system. The suffix boolean toggles the project units on or off; unwired: Elements, ParameterName
setParameterSetValueString_2 = Custom[SetParameterSetValueString]()  # unwired: Elements, ParameterName, Values
categories = Categories("StructuralFoundation")
all_elements_of_category = ElementsOfCategory(categories)
watch_9 = Watch(all_elements_of_category)
elementResetParameterByName = Custom[ElementResetParameterByName](element=watch_9, parameterName=string_2)  # Reset a parameter by name. String in null, Yes/No in No, and number to 0.
watch_10 = Watch(elementResetParameterByName)
