# Dynamo graph worksets.dyn (Dynamo 1.3.3.4111)

file_path = Filename("E:\SABS DATA\MOD\WORKSETS FOR MOD PROJECT.xlsx")
fromPath = FileObject(file_path)  # "File.FromPath"
string = StringInput("FIRE")
boolean = BoolSelector(false)
readFromFile = Excel.ReadFromFile(file=fromPath, sheetName=string, readAsStrings=boolean)
transpose = List.Transpose(readFromFile)
number = DoubleInput(0)
getItemAtIndex = List.GetItemAtIndex(list=transpose, index=number)
watch = Watch(getItemAtIndex)
create = Custom[Workset.Create](names=watch)  # Creates worksets, input is a string or list of strings. Existing worksetnames are ignored.
watch_2 = Watch(create)
